# Grasshopper definition Autodesk_installation_210220_alt01.gh (Grasshopper 1.0.7)
# plug-ins: Wombat, Parakeet, Pufferfish, Kangaroo2 Components, Weaverbird, Kangaroo Components

crv = Curve([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])
text2crv = TextOutlines(TextContent="AUTODESK", Plane=PlaneXY(0, 0, 0), Face="Arial", Size=12, Bold=False, Italics=False)  # -> TextCurves, TextBoundingBox
reb = RebuildCurve(Curve=crv, Degree=Slider(1, range=0..1), Count=Slider(58, range=0..100), Tangents=False)

area = Area(Geometry=reb)  # -> Area, Centroid
scale = Scale(Geometry=reb, Center=area.Centroid, Factor=Slider(0.83, range=0..1))  # -> Geometry, Transform
cullpt = CullDuplicates(Points=area.Centroid, Tolerance=Slider(9, range=0..100), CullMode=1)  # -> Points, Indices, Valence
item = ListItem(List=scale.Geometry, Index=cullpt.Indices, Wrap=True)

# ----
# Slicing Upper Frame
number_slider = Slider(8, range=0..10)
range = Range(Domain=Domain(0, 1), Steps=number_slider)
shift = ShiftList(List=range, Shift=1, Wrap=invert(True))
brec = BoundingRectangle(Geometry=reb, Plane=PlaneXY(0, 0, 0), Axis=0, Slide=0, Union=True)  # -> Bounding, DimensionX, DimensionY
cull_i = CullIndex(List=range, Indices=number_slider, Wrap=True)
dom = ConstructDomain(DomainStart=cull_i, DomainEnd=shift)
dom² = ConstructDomain²(DomainU=dom, DomainV=Domain(0, 1))
subsrf = Isotrim(Surface=reparameterize(brec.Bounding), Domain=dom²)
crv_2 = Curve(subsrf)

Z = UnitZ(Factor=Slider(6, range=0..100))
move = Move(Geometry=crv_2, Motion=Z)  # -> Geometry, Transform

data = Data(item)

# ----
# rationalizing upper and lower frames
number_slider_2 = Slider(3, range=0..10)
number_slider_3 = Slider(10, range=0..30)
explode = Explode(Curve=move.Geometry, Recursive=True)  # -> Segments, Vertices
multiplication = Multiplication(A=number_slider_3, B=4)
reb_2 = RebuildCurve(Curve=explode.Segments, Degree=number_slider_2, Count=number_slider_3, Tangents=False)
reb_3 = RebuildCurve(Curve=data, Degree=number_slider_2, Count=multiplication, Tangents=False)
join = JoinCurves(Curves=reb_2, Preserve=False)  # -> flatten(Curves)
merge = Merge(Data1=simplify(graft(join)), Data2=simplify(graft(reb_3)))

item_2 = ListItem(List=merge, Index=0, Wrap=True)
aligncrv = AlignCurves(Curves=merge, Guide=item_2)

# ----
# guid curves
item_3 = ListItem(List=aligncrv, Index=0, Wrap=True)  # -> Item, Item1
range_2 = Range(Domain=Domain(0, 1), Steps=10)
tweencrv = TweenCurve(CurveA=item_3.Item, CurveB=item_3.Item1, Factor=range_2, BlendType=0)

explode_2 = Explode(Curve=tweencrv, Recursive=True)  # -> Segments, flatten(Vertices)
loft = Loft(Curves=tweencrv, Options={Adjust=False, Closed=False, LoftEnds=0, LoftSimp=1, LoftType=0, Rebuild=10, Refit=0.01})  # -> flatten(Loft)
join_2 = BrepJoin(Breps=loft)  # -> Breps, Closed
simpleremesh = SimpleRemesh(
    Geometry=graft(join_2.Breps),
    Length=Slider(0.89, range=0.7..1),
    Corners=simplify(explode_2.Vertices),
    Steps=Slider(1, range=0..10))
mjoin = MeshJoin(Meshes=flatten(simpleremesh))
wbjoin = WeaverbirdsJoinMeshesAndWeld(Mesh=mjoin, Weld="True")
weld = WeldMesh(Mesh=mjoin, Angle=3.141592654)
alignvert = AlignVertices(Mesh=weld, Tolerance=0.01)  # -> Result, Count
show = Show(G=wbjoin)
edgelengths = EdgeLengths(Mesh=wbjoin, LengthFactor=Slider(0.26, range=0..1), Strength=Slider(200, range=0..1000))
nv = NakedVertices(Mesh=wbjoin)  # -> ClothedIndex, NakedIndex, ClothedPts, NakedPts
sg = SoapFilm(Mesh=wbjoin, Strength=Slider(630, range=0..1000))
anchor = Anchor(Point=nv.NakedPts, Strength=Slider(10000, range=0..10000))
entwine = Entwine(Branch00=show, Branch01=anchor, Branch02=sg, Branch03=edgelengths, FlattenInputs=True)
solver = Solver(GoalObjects=entwine, Reset=Button(), Threshold=1e-15, Tolerance=0.01, On=Toggle(False))  # -> I, V, O
bang = ExplodeTree(Data=solver.O)  # -> Branch0, Branch1
mesh = Mesh(bang.Branch0)
