# Grasshopper definition font_transformation_210302_alt02.gh (Grasshopper 1.0.7)
# plug-ins: Wombat, Parakeet, Pufferfish, Kangaroo2 Components, Kangaroo Components, Weaverbird

crv = Curve([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])
text2crv = TextOutlines(TextContent="AUTODESK", Plane=PlaneXY(0, 0, 0), Face="Arial", Size=12, Bold=False, Italics=False)  # -> TextCurves, TextBoundingBox
data = Data(crv)
reb = RebuildCurve(Curve=crv, Degree=Slider(1, range=0..1), Count=Slider(58, range=0..100), Tangents=False)
data_2 = Data(reb)

area = Area(Geometry=data_2)  # -> Area, Centroid
scale = Scale(Geometry=data_2, Center=area.Centroid, Factor=Slider(0.83, range=0..1))  # -> Geometry, Transform
cullpt = CullDuplicates(Points=area.Centroid, Tolerance=Slider(9, range=0..100), CullMode=1)  # -> Points, Indices, Valence
item = ListItem(List=scale.Geometry, Index=cullpt.Indices, Wrap=True)

area_2 = Area(Geometry=data)  # -> Area, Centroid
scale_2 = Scale(Geometry=data, Center=area_2.Centroid, Factor=Slider(0.83, range=0..1))  # -> Geometry, Transform
cullpt_2 = CullDuplicates(Points=area_2.Centroid, Tolerance=Slider(9, range=0..100), CullMode=1)  # -> Points, Indices, Valence
item_2 = ListItem(List=scale_2.Geometry, Index=cullpt_2.Indices, Wrap=True)

# ----
# Slicing Upper Frame
number_slider = Slider(8, range=0..10)
range = Range(Domain=Domain(0, 1), Steps=number_slider)
shift = ShiftList(List=range, Shift=1, Wrap=invert(True))
brec = BoundingRectangle(Geometry=reb, Plane=PlaneXY(0, 0, 0), Axis=0, Slide=0, Union=True)  # -> Bounding, DimensionX, DimensionY
cull_i = CullIndex(List=range, Indices=number_slider, Wrap=True)
dom = ConstructDomain(DomainStart=cull_i, DomainEnd=shift)
dom² = ConstructDomain²(DomainU=dom, DomainV=Domain(0, 1))
subsrf = Isotrim(Surface=reparameterize(brec.Bounding), Domain=dom²)
crv_2 = Curve(subsrf)

number_slider_2 = Slider(6, range=0..100)
Z = UnitZ(Factor=number_slider_2)
move = Move(Geometry=crv_2, Motion=Z)  # -> Geometry, Transform

data_3 = Data(item)

# ----
# rationalizing upper and lower frames
number_slider_3 = Slider(3, range=0..10)
number_slider_4 = Slider(10, range=0..30)
explode = Explode(Curve=move.Geometry, Recursive=True)  # -> Segments, Vertices
multiplication = Multiplication(A=number_slider_4, B=4)
reb_2 = RebuildCurve(Curve=explode.Segments, Degree=number_slider_3, Count=number_slider_4, Tangents=False)
reb_3 = RebuildCurve(Curve=data_3, Degree=number_slider_3, Count=multiplication, Tangents=False)
join = JoinCurves(Curves=reb_2, Preserve=False)  # -> flatten(Curves)
merge = Merge(Data1=simplify(graft(join)), Data2=simplify(graft(reb_3)))

item_3 = ListItem(List=merge, Index=0, Wrap=True)
aligncrv = AlignCurves(Curves=merge, Guide=item_3)

# ----
# guid curves
item_4 = ListItem(List=aligncrv, Index=0, Wrap=True)  # -> Item, Item1
range_2 = Range(Domain=Domain(0, 1), Steps=Slider(2, range=0..10))
tweencrv = TweenCurve(CurveA=item_4.Item, CurveB=item_4.Item1, Factor=range_2, BlendType=0)

disc = Discontinuity(Curve=aligncrv, Level=1)  # -> flatten(Points), Parameters
loft = Loft(Curves=tweencrv, Options={Adjust=False, Closed=False, LoftEnds=0, LoftSimp=1, LoftType=0, Rebuild=10, Refit=0.01})  # -> flatten(Loft)
crv_3 = Curve(item_2)
pt = Point(flatten(aligncrv))
disc_2 = Discontinuity(Curve=crv_3, Level=1)  # -> Points, Parameters
join_2 = BrepJoin(Breps=loft)  # -> Breps, Closed
pt_2 = Point(flatten([disc_2.Points, disc.Points]))
simpleremesh = SimpleRemesh(
    Geometry=graft(join_2.Breps),
    Length=Slider(0.89, range=0.7..1),
    Corners=simplify(flatten(pt_2)),
    Steps=Slider(1, range=0..10))
mjoin = MeshJoin(Meshes=flatten(simpleremesh))
show = Show(G=mjoin)
edgelengths = EdgeLengths(Mesh=mjoin, LengthFactor=Slider(0.26, range=0..1), Strength=Slider(200, range=0..1000))
nv = NakedVertices(Mesh=mjoin)  # -> ClothedIndex, NakedIndex, ClothedPts, NakedPts
devec = DeconstructVector(Vector=nv.NakedPts)  # -> XComponent, YComponent, ZComponent
equals = Equality(FirstNumber=devec.ZComponent, SecondNumber=number_slider_2)  # -> Equality, Inequality
sg = SoapFilm(Mesh=mjoin, Strength=Slider(630, range=0..1000))
dispatch = Dispatch(List=nv.NakedPts, DispatchPattern=equals.Equality)  # -> ListA, ListB
pt_3 = Point(dispatch.ListB)

# ----
# clustring points
# for each character
crv_cp = CurveClosestPoint(Point=graft(dispatch.ListB), Curve=item_2)  # -> Point, Parameter, Distance
lng = ListLength(List=crv_cp.Point)
series = Series(Start=0, Step=1, Count=lng)
sort = SortList(Keys=crv_cp.Distance, ValuesB=series)  # -> Keys, ValuesB
item_5 = ListItem(List=sort.ValuesB, Index=0, Wrap=True)  # -> flatten(Item)
cset = CreateSet(List=item_5)  # -> Set, Map
equals_2 = Equality(FirstNumber=item_5, SecondNumber=graft(cset.Set))  # -> Equality, Inequality
ma = MassAddition(Input=equals_2.Equality)  # -> flatten(Result), PartialResults
partition = PartitionList(List=reverse(pt_3), Size=reverse(ma.Result))

disc_3 = Discontinuity(Curve=item_2, Level=1)  # -> Points, Parameters
crv_4 = Curve(item_2)

# ----
# fair distribution of points
# including discontinuities
# number of points on curve
# must be equal to number of
# points of mesh
lng_2 = ListLength(List=disc_3.Points)
data_4 = Data(reverse(ma.Result))
subtraction = Subtraction(A=simplify(graft(data_4)), B=simplify(lng_2))
divide = DivideCurve(Curve=graft(crv_4), Count=subtraction, Kinks=False)  # -> Points, Tangents, Parameters
merge_2 = Merge(Data1=simplify(divide.Points), Data2=simplify(disc_3.Points))

pt_4 = Point(dispatch.ListA)
alongcrv = SortAlongCurve(Points=simplify(partition), Curve=simplify(graft(crv_4)))  # -> simplify(Points), Indices
alongcrv_2 = SortAlongCurve(Points=merge_2, Curve=graft(crv_4))  # -> simplify(Points), Indices
number_slider_5 = Slider(10000, range=0..10000)
anchor = Anchor(Point=pt_4, Strength=number_slider_5)
anchor_2 = Anchor(Point=alongcrv.Points, Target=alongcrv_2.Points, Strength=number_slider_5)  # -> flatten(A)
entwine = Entwine(Branch00=show, Branch01=anchor, Branch02=sg, Branch03=anchor_2, Branch04=edgelengths, FlattenInputs=True)
solver = Solver(GoalObjects=entwine, Reset=Button(), Threshold=Slider(0.001, range=0..0.001), Tolerance=0.01, On=Toggle(False))  # -> I, V, O
bang = ExplodeTree(Data=solver.O)  # -> Branch0, Branch1
mesh = Mesh(bang.Branch0)
wbloop = WeaverbirdsLoopSubdivision(MeshCurves=mesh, Level=Slider(3, range=0..10), SmoothNakedEdges=Slider(0, range=0..100))
preview = CustomPreview(Geometry=wbloop, Material=ColourSwatch(SwatchColor=RGB(245, 5, 5)))
